# Grasshopper definition Quadrilateral Incompatible Elements.gh (Grasshopper 1.0.8)
# plug-ins: RhinoCodePluginGH, Bifocals

number_slider = Slider(100, range=0..100)
number_slider_2 = Slider(10, range=0..10)
xy_plane = XYPlane(Origin=Point(0, 0, 0))
quad_remesh_settings = QuadRemeshSettings(
    TargetCount=Slider(100, range=0..1000),
    AdaptiveSize=0,
    AdaptiveCount=False,
    HardEdges=False,
    SeamEdges=0,
    Symmetry=0,
    GuideCurves=0)
# ▽メッシュ作成
plane_surface = PlaneSurface(Plane=xy_plane, XSize=number_slider, YSize=number_slider_2)
quad_remesh = QuadRemesh(Geometry=plane_surface, Settings=quad_remesh_settings)
mesh_edges = MeshEdges(Mesh=quad_remesh)  # -> NakedEdges, InteriorEdges, NonManifoldEdges
deconstruct_mesh = DeconstructMesh(Mesh=quad_remesh)  # -> Vertices, Faces, Colours, Normals

# ---- group: Load
deconstruct = Deconstruct(Point=deconstruct_mesh.Vertices)  # -> XComponent, YComponent, ZComponent
larger_than = LargerThan(FirstNumber=deconstruct.XComponent, SecondNumber=number_slider)  # -> LargerThan, OrEqualTo
load_n = Slider(100, range=0..100)
cull_pattern = CullPattern(List=deconstruct_mesh.Vertices, CullPattern=larger_than.OrEqualTo)  # -> flatten(List)
list_length = ListLength(List=cull_pattern)
item_index = ItemIndex(List=deconstruct_mesh.Vertices, Item=cull_pattern)
division = Division(A=load_n, B=list_length)
boundary = CSharpScript(VerticesIDs=item_index, FX=Slider(0, range=0..100), FY=division)  # -> Loads; inputs VerticesIDs: list of Int32, FX: Double, FY: Double
# ---------- boundary: C# ----------
// Grasshopper Script Instance
#region Usings
using System;
using System.Linq;
using System.Collections;
using System.Collections.Generic;
using System.Drawing;

using Rhino;
using Rhino.Geometry;

using Grasshopper;
using Grasshopper.Kernel;
using Grasshopper.Kernel.Data;
using Grasshopper.Kernel.Types;
#endregion

public class Script_Instance : GH_ScriptInstance
{
    #region Notes
    /* 
      Members:
        RhinoDoc RhinoDocument
        GH_Document GrasshopperDocument
        IGH_Component Component
        int Iteration

      Methods (Virtual & overridable):
        Print(string text)
        Print(string format, params object[] args)
        Reflect(object obj)
        Reflect(object obj, string method_name)
    */
    #endregion

    private void RunScript(
	List<int> VerticesIDs,
	double FX,
	double FY,
	ref object Loads)
    {
        var res = new List<(int ID,int VertexID,double FX,double FY)>();
        for(int i = 0; i < VerticesIDs.Count ; i++ )
        {
            res.Add((i,VerticesIDs[i],FX,FY));
        }
        Loads = res;
    }
}
# ---------- end boundary ----------

# ---- group: Boundary Condition
deconstruct_2 = Deconstruct(Point=deconstruct_mesh.Vertices)  # -> XComponent, YComponent, ZComponent
# ▽境界条件
smaller_than = SmallerThan(FirstNumber=deconstruct_2.XComponent, SecondNumber="0.01")  # -> SmallerThan, OrEqualTo
# ▽荷重
boolean_toggle = BooleanToggle(True)
cull_pattern_2 = CullPattern(List=deconstruct_mesh.Vertices, CullPattern=smaller_than.OrEqualTo)
item_index_2 = ItemIndex(List=deconstruct_mesh.Vertices, Item=cull_pattern_2)
boundary_2 = CSharpScript(VerticesIDs=item_index_2, DX=boolean_toggle, DY=boolean_toggle)  # -> Boundaries; inputs VerticesIDs: list of Int32, DX: Boolean, DY: Boolean
# ---------- boundary_2: C# ----------
// Grasshopper Script Instance
#region Usings
using System;
using System.Linq;
using System.Collections;
using System.Collections.Generic;
using System.Drawing;

using Rhino;
using Rhino.Geometry;

using Grasshopper;
using Grasshopper.Kernel;
using Grasshopper.Kernel.Data;
using Grasshopper.Kernel.Types;
#endregion

public class Script_Instance : GH_ScriptInstance
{
    #region Notes
    /* 
      Members:
        RhinoDoc RhinoDocument
        GH_Document GrasshopperDocument
        IGH_Component Component
        int Iteration

      Methods (Virtual & overridable):
        Print(string text)
        Print(string format, params object[] args)
        Reflect(object obj)
        Reflect(object obj, string method_name)
    */
    #endregion

    private void RunScript(
	List<int> VerticesIDs,
	bool DX,
	bool DY,
	ref object Boundaries)
    {
        var res = new List<(int ID,int VertexID,bool DX,bool DY)>();
        for(int i = 0; i < VerticesIDs.Count ; i++ )
        {
            res.Add((i,VerticesIDs[i],DX,DY));
        }
        Boundaries = res;
    }
}
# ---------- end boundary_2 ----------

# ----
# ▽材質・断面
nu = Slider(0.3, range=-0.8..0.8)
thickness_mm = Slider(10, range=0..10)
e_n_mm2 = Panel("205000")

# ----
# ▽解析実行
solver = CSharpScript(Mesh=quad_remesh, E=e_n_mm2, Nu=nu, Section=thickness_mm, Boundaries=boundary_2, Loads=boundary)  # -> Disp; inputs Mesh: Mesh, E: Double, Nu: Double, Section: Double, Boundaries: list, Loads: list
# ---------- solver: C# ----------
// Grasshopper Script Instance
#region Usings
using System;
#r "nuget: MathNet.Numerics"

using System.Linq;
using System.Collections;
using System.Collections.Generic;
using System.Drawing;

using Rhino;
using Rhino.Geometry;
using Rhino.Geometry.Collections;


using Grasshopper;
using Grasshopper.Kernel;
using Grasshopper.Kernel.Data;
using Grasshopper.Kernel.Types;

using MathNet.Numerics.LinearAlgebra;


#endregion

public class Script_Instance : GH_ScriptInstance
{
    #region Notes
    /* 
      Members:
        RhinoDoc RhinoDocument
        GH_Document GrasshopperDocument
        IGH_Component Component
        int Iteration

      Methods (Virtual & overridable):
        Print(string text)
        Print(string format, params object[] args)
        Reflect(object obj)
        Reflect(object obj, string method_name)
    */
    #endregion

    double[,] gps = new double[,]
    {
        {-1.0 / Math.Sqrt(3.0), -1.0 / Math.Sqrt(3.0), 1.0, 1.0 },
        { 1.0 / Math.Sqrt(3.0), -1.0 / Math.Sqrt(3.0), 1.0, 1.0},
        { 1.0 / Math.Sqrt(3.0), 1.0 / Math.Sqrt(3.0), 1.0, 1.0},
        { -1.0 / Math.Sqrt(3.0), 1.0 / Math.Sqrt(3.0), 1.0, 1.0}//(xi,eta,wi,wj)
    };
    
    private void RunScript(
	Mesh Mesh,
	double E,
	double Nu,
	double Section,
	List<object> Boundaries,
	List<object> Loads,
	ref object Disp)
    {
        Matrix<double> D = calcD(E,Nu);
        var faces = Mesh.Faces;
        var vertices = Mesh.Vertices;

        //剛性マトリクスの計算
        Matrix<double> K = Matrix<double>.Build.Dense(vertices.Count * 2, vertices.Count * 2);
        for(int i = 0; i < faces.Count; i++)
        {
            MeshFace face = faces.GetFace(i);
            Matrix<double> x = Matrix<double>.Build.DenseOfArray(new double[,]
            {
                {vertices[face.A].X},{vertices[face.B].X},{vertices[face.C].X},{vertices[face.D].X}
            });
            Matrix<double> y = Matrix<double>.Build.DenseOfArray(new double[,]
            {
                {vertices[face.A].Y},{vertices[face.B].Y},{vertices[face.C].Y},{vertices[face.D].Y}
            });
            Matrix<double> Ke = calcKe(x,y,Section,D,gps);

            for (int j = 0; j < 4; j++)
            {
                for (int k = 0; k < 4; k++)
                {
                    int nodej = GetFaceVertexIndex(face,j);
                    int nodek = GetFaceVertexIndex(face,k);
                    K[2 * nodej, 2 * nodek] += Ke[2 * j, 2 * k];
                    K[2 * nodej, 2 * nodek + 1] += Ke[2 * j, 2 * k + 1];
                    K[2 * nodej + 1, 2 * nodek] += Ke[2 * j + 1, 2 * k];
                    K[2 * nodej + 1, 2 * nodek + 1] += Ke[2 * j + 1, 2 * k + 1];
                }
            }
        }

        //荷重条件の設定
        Matrix<double> f = Matrix<double>.Build.Dense(vertices.Count * 2, 1);
        for(int i = 0 ; i < Loads.Count ; i++ )
        {
            var load = ((int ID,int VertexID,double FX,double FY)) Loads[i];
            f[load.VertexID * 2, 0] = load.FX;
            f[load.VertexID * 2 + 1, 0] = load.FY;
        }


        //境界条件の設定
        for(int i = 0; i < Boundaries.Count; i++)
        {
            var  boundary = ((int ID,int VertexID,bool DX,bool DY)) Boundaries[i];
            if(boundary.DX)
            {
                for (int j = 0; j < vertices.Count * 2; j++)
                {
                    K[boundary.VertexID * 2, j] = 0.0;
                    K[j, boundary.VertexID * 2] = 0.0;
                }
                K[boundary.VertexID * 2, boundary.VertexID * 2] = 1.0; 
                f[boundary.VertexID * 2,0] = 0.0;    
            }
            if(boundary.DY)
            {
                for (int j = 0; j < vertices.Count * 2; j++)
                {
                    K[boundary.VertexID * 2 + 1, j] = 0.0;
                    K[j, boundary.VertexID * 2 + 1] = 0.0;
                }
                K[boundary.VertexID * 2 + 1, boundary.VertexID * 2 + 1] = 1.0;    
                f[boundary.VertexID * 2 + 1,0] = 0.0;     
            }
        }
        

        //行列計算
        Matrix<double> d = K.Solve(f);
        //Matrix<double> d = K.Inverse() * f;
        Disp = d.Enumerate().ToList();
    }

    //Dマトリクスの算定
    private Matrix<double> calcD(double E , double nu)
    {
        Matrix<double> D = Matrix<double>.Build.DenseOfArray(new double[,]
        {
            {1, nu, 0},
            {nu, 1, 0},
            {0, 0, (1-nu)/2}
        });
        D = D * E / (1 - Math.Pow(nu, 2));
        return D;
    }
    //Jマトリクスの算定
    private Matrix<double> calcJ(Matrix<double> x,Matrix<double> y,double xi,double eta)
    {
        Matrix<double> dndxi = Matrix<double>.Build.DenseOfArray(new double[,]
        {
                {(-1+eta)/4,(1-eta)/4,(1+eta)/4,(-1-eta)/4 }
        });
        Matrix<double> dndeta = Matrix<double>.Build.DenseOfArray(new double[,]
        {
                {(-1+xi)/4,(-1-xi)/4,(1+xi)/4,(1-xi)/4 }
        });

        Matrix<double> dxdxi = dndxi * x;
        Matrix<double> dydxi = dndxi * y;
        Matrix<double> dxdeta = dndeta * x;
        Matrix<double> dydeta = dndeta * y;

        Matrix<double> J = Matrix<double>.Build.DenseOfArray(new double[,]
        {
            {dxdxi[0,0],dydxi[0,0]},
            {dxdeta[0, 0],dydeta[0, 0]}
        });
        return J;
    }
    private Matrix<double> calcB(Matrix<double> x,Matrix<double> y,double xi,double eta)
    {
        Matrix<double> dndxi = Matrix<double>.Build.DenseOfArray(new double[,]
        {
                {(-1+eta)/4,(1-eta)/4,(1+eta)/4,(-1-eta)/4 }
        });
        Matrix<double> dndeta = Matrix<double>.Build.DenseOfArray(new double[,]
        {
                {(-1+xi)/4,(-1-xi)/4,(1+xi)/4,(1-xi)/4 }
        });
        
        Matrix<double> J = calcJ(x,y,xi,eta);
        Matrix<double> invJ = J.Inverse();

        Matrix<double> B = Matrix<double>.Build.Dense(3, 8);

        for (int i = 0; i < 4; i++)
        {
            //負荷が大きいので、逆行列は計算しない
            //Matrix<double> Bi = invJ * Matrix<double>.Build.DenseOfArray(new double[2, 1] { { dndxi[0, i] }, { dndeta[0, i] } });
            Matrix<double> Bi = J.Solve(Matrix<double>.Build.DenseOfArray(new double[2, 1] { { dndxi[0, i] }, { dndeta[0, i] } }));
            B[0, 2 * i] = Bi[0, 0];
            B[1, 2 * i + 1] = Bi[1, 0];
            B[2, 2 * i] = Bi[1, 0];
            B[2, 2 * i + 1] = Bi[0, 0];
            
        }
        return B; 
    }
    private Matrix<double> calcKe(Matrix<double> x,Matrix<double> y,double section ,Matrix<double> D,double[,]gps)
    {
        Matrix<double> Ke = Matrix<double>.Build.DenseOfArray(new double[8, 8]);//８ｘ８のゼロ行列
        for (int i = 0; i < gps.GetLength(0); i++)
        {
            double xi = gps[i, 0];
            double eta = gps[i, 1];
            double wi = gps[i, 2];
            double wj = gps[i, 3];
            Matrix<double> J = calcJ(x,y, xi, eta);
            Matrix<double> B = calcB(x,y, xi, eta);
            Matrix<double> Kei = B.Transpose() * D * B * J.Determinant() * section * wi * wj;
            Ke += Kei;
        }
        return Ke;
    }
    private int GetFaceVertexIndex(MeshFace face, int i)
    {
        return i switch
        {
            0 => face.A,
            1 => face.B,
            2 => face.C,
            3 => face.IsQuad ? face.D : face.C, // 三角形のときD=C
            _ => throw new ArgumentOutOfRangeException(nameof(i))
        };
    }
}
# ---------- end solver ----------

expression = Expression(B=thickness_mm, H=number_slider_2, L=number_slider, E=e_n_mm2, P=load_n, Expression="P•L³/(3•E•(B•H³/12))")
c_script = CSharpScript(Disp=solver)  # -> flatten(MaxDisp); inputs Disp: list of Double
# ---------- c_script: C# ----------
// Grasshopper Script Instance
#region Usings
using System;
using System.Linq;
using System.Collections;
using System.Collections.Generic;
using System.Drawing;

using Rhino;
using Rhino.Geometry;

using Grasshopper;
using Grasshopper.Kernel;
using Grasshopper.Kernel.Data;
using Grasshopper.Kernel.Types;
#endregion

public class Script_Instance : GH_ScriptInstance
{
    #region Notes
    /* 
      Members:
        RhinoDoc RhinoDocument
        GH_Document GrasshopperDocument
        IGH_Component Component
        int Iteration

      Methods (Virtual & overridable):
        Print(string text)
        Print(string format, params object[] args)
        Reflect(object obj)
        Reflect(object obj, string method_name)
    */
    #endregion

    private void RunScript(List<double> Disp, ref object MaxDisp)
    {
        var D = new List<double>();
        for(int i =0; i<Disp.Count/2 ; i++)
        {
            D.Add(Disp[i+1]);
        }
        // Write your logic here
        MaxDisp = D.Max();
    }
}
# ---------- end c_script ----------
# ▽検証
panel = Panel(c_script)
panel_2 = Panel(expression)
concatenate = Concatenate(FragmentA="解析値：", FragmentB=panel)
concatenate_2 = Concatenate(FragmentA="理論値：", FragmentB=panel_2)
number_slider_3 = Slider(-10, range=-30..-10)
division_2 = Division(A=number_slider_3, B=2)
number_slider_4 = Slider(2.736, range=0..10)
construct_point = ConstructPoint(XCoordinate=0, YCoordinate=number_slider_3, ZCoordinate=0)
construct_point_2 = ConstructPoint(XCoordinate=0, YCoordinate=division_2, ZCoordinate=0)
text_tag_3d = TextTag3D(Location=construct_point, Text=concatenate, Size=number_slider_4, Justification=7)
text_tag_3d_2 = TextTag3D(Location=construct_point_2, Text=concatenate_2, Size=number_slider_4, Justification=7)

# ----
# ▽描画
c_script_2 = CSharpScript(Mesh=quad_remesh, Disp=solver, DeformationRatio=Slider(57, range=0..1000))  # -> DeformedMesh; inputs Mesh: Mesh, Disp: list of Double, DeformationRatio: Double
# ---------- c_script_2: C# ----------
// Grasshopper Script Instance
#region Usings
using System;
using System.Linq;
using System.Collections;
using System.Collections.Generic;
using System.Drawing;

using Rhino;
using Rhino.Geometry;

using Grasshopper;
using Grasshopper.Kernel;
using Grasshopper.Kernel.Data;
using Grasshopper.Kernel.Types;
#endregion

public class Script_Instance : GH_ScriptInstance
{
    #region Notes
    /* 
      Members:
        RhinoDoc RhinoDocument
        GH_Document GrasshopperDocument
        IGH_Component Component
        int Iteration

      Methods (Virtual & overridable):
        Print(string text)
        Print(string format, params object[] args)
        Reflect(object obj)
        Reflect(object obj, string method_name)
    */
    #endregion

    private void RunScript(
	Mesh Mesh,
	List<double> Disp,
	double DeformationRatio,
	ref object DeformedMesh)
    {
        //変形後のメッシュの描画
        Mesh deformedMesh = Mesh.DuplicateMesh();
        int vertexCount = deformedMesh.Vertices.Count;

        // 各頂点に変位を加える
        for (int i = 0; i < vertexCount; i++)
        {
            Point3d original = deformedMesh.Vertices[i];
            Vector3d vec = new Vector3d(Disp[i * 2],Disp[i * 2 + 1],0.0);

            // 変位を反映
            Point3d moved = new Point3d(original) + vec * DeformationRatio;
            deformedMesh.Vertices.SetVertex(i, moved);
        }

        DeformedMesh = deformedMesh;
    }
}
# ---------- end c_script_2 ----------
mesh_edges_2 = MeshEdges(Mesh=c_script_2)  # -> NakedEdges, InteriorEdges, NonManifoldEdges
