# Grasshopper definition Non-conforming Quadrilateral Elements.gh (Grasshopper 1.0.8)
# plug-ins: RhinoCodePluginGH, Bifocals

number_slider = Slider(100, range=0..100)
number_slider_2 = Slider(10, range=0..10)
xy_plane = XYPlane(Origin=Point(0, 0, 0))
quad_remesh_settings = QuadRemeshSettings(
    TargetCount=Slider(5, range=0..500),
    AdaptiveSize=0,
    AdaptiveCount=False,
    HardEdges=False,
    SeamEdges=0,
    Symmetry=0,
    GuideCurves=0)
# ▽メッシュ作成
plane_surface = PlaneSurface(Plane=xy_plane, XSize=number_slider, YSize=number_slider_2)
quad_remesh = QuadRemesh(Geometry=plane_surface, Settings=quad_remesh_settings)
mesh_edges = MeshEdges(Mesh=quad_remesh)  # -> NakedEdges, InteriorEdges, NonManifoldEdges
deconstruct_mesh = DeconstructMesh(Mesh=quad_remesh)  # -> Vertices, Faces, Colours, Normals

# ---- group: Boundary Condition
deconstruct = Deconstruct(Point=deconstruct_mesh.Vertices)  # -> XComponent, YComponent, ZComponent
# ▽境界条件
smaller_than = SmallerThan(FirstNumber=deconstruct.XComponent, SecondNumber="0.01")  # -> SmallerThan, OrEqualTo
# ▽荷重
boolean_toggle = BooleanToggle(True)
cull_pattern = CullPattern(List=deconstruct_mesh.Vertices, CullPattern=smaller_than.OrEqualTo)
item_index = ItemIndex(List=deconstruct_mesh.Vertices, Item=cull_pattern)
boundary = CSharpScript(VerticesIDs=item_index, DX=boolean_toggle, DY=boolean_toggle)  # -> Boundaries; inputs VerticesIDs: list of Int32, DX: Boolean, DY: Boolean
# ---------- boundary: C# ----------
// Grasshopper Script Instance
#region Usings
using System;
using System.Linq;
using System.Collections;
using System.Collections.Generic;
using System.Drawing;

using Rhino;
using Rhino.Geometry;

using Grasshopper;
using Grasshopper.Kernel;
using Grasshopper.Kernel.Data;
using Grasshopper.Kernel.Types;
#endregion

public class Script_Instance : GH_ScriptInstance
{
    #region Notes
    /* 
      Members:
        RhinoDoc RhinoDocument
        GH_Document GrasshopperDocument
        IGH_Component Component
        int Iteration

      Methods (Virtual & overridable):
        Print(string text)
        Print(string format, params object[] args)
        Reflect(object obj)
        Reflect(object obj, string method_name)
    */
    #endregion

    private void RunScript(
	List<int> VerticesIDs,
	bool DX,
	bool DY,
	ref object Boundaries)
    {
        var res = new List<(int ID,int VertexID,bool DX,bool DY)>();
        for(int i = 0; i < VerticesIDs.Count ; i++ )
        {
            res.Add((i,VerticesIDs[i],DX,DY));
        }
        Boundaries = res;
    }
}
# ---------- end boundary ----------

# ---- group: Load
deconstruct_2 = Deconstruct(Point=deconstruct_mesh.Vertices)  # -> XComponent, YComponent, ZComponent
larger_than = LargerThan(FirstNumber=deconstruct_2.XComponent, SecondNumber=number_slider)  # -> LargerThan, OrEqualTo
load_n = Slider(100, range=0..100)
cull_pattern_2 = CullPattern(List=deconstruct_mesh.Vertices, CullPattern=larger_than.OrEqualTo)  # -> flatten(List)
list_length = ListLength(List=cull_pattern_2)
item_index_2 = ItemIndex(List=deconstruct_mesh.Vertices, Item=cull_pattern_2)
division = Division(A=load_n, B=list_length)
boundary_2 = CSharpScript(VerticesIDs=item_index_2, FX=Slider(0, range=0..100), FY=division)  # -> Loads; inputs VerticesIDs: list of Int32, FX: Double, FY: Double
# ---------- boundary_2: C# ----------
// Grasshopper Script Instance
#region Usings
using System;
using System.Linq;
using System.Collections;
using System.Collections.Generic;
using System.Drawing;

using Rhino;
using Rhino.Geometry;

using Grasshopper;
using Grasshopper.Kernel;
using Grasshopper.Kernel.Data;
using Grasshopper.Kernel.Types;
#endregion

public class Script_Instance : GH_ScriptInstance
{
    #region Notes
    /* 
      Members:
        RhinoDoc RhinoDocument
        GH_Document GrasshopperDocument
        IGH_Component Component
        int Iteration

      Methods (Virtual & overridable):
        Print(string text)
        Print(string format, params object[] args)
        Reflect(object obj)
        Reflect(object obj, string method_name)
    */
    #endregion

    private void RunScript(
	List<int> VerticesIDs,
	double FX,
	double FY,
	ref object Loads)
    {
        var res = new List<(int ID,int VertexID,double FX,double FY)>();
        for(int i = 0; i < VerticesIDs.Count ; i++ )
        {
            res.Add((i,VerticesIDs[i],FX,FY));
        }
        Loads = res;
    }
}
# ---------- end boundary_2 ----------

# ----
# ▽材質・断面
nu = Slider(0.3, range=-0.8..0.8)
thickness_mm = Slider(2, range=0..10)
e_n_mm2 = Panel("205000")

# ----
# ▽解析実行
solver = CSharpScript(Mesh=quad_remesh, E=e_n_mm2, Nu=nu, Section=thickness_mm, Boundaries=boundary, Loads=boundary_2)  # -> flatten(Disp), Stress; inputs Mesh: Mesh, E: Double, Nu: Double, Section: Double, Boundaries: list, Loads: list
# ---------- solver: C# ----------
// Grasshopper Script Instance
#region Usings
using System;
#r "nuget: MathNet.Numerics"

using System.Linq;
using System.Collections;
using System.Collections.Generic;
using System.Drawing;

using Rhino;
using Rhino.Geometry;
using Rhino.Geometry.Collections;


using Grasshopper;
using Grasshopper.Kernel;
using Grasshopper.Kernel.Data;
using Grasshopper.Kernel.Types;

using MathNet.Numerics.LinearAlgebra;
using Matrix = MathNet.Numerics.LinearAlgebra.Matrix<double>;



#endregion

public class Script_Instance : GH_ScriptInstance
{
    #region Notes
    /* 
      Members:
        RhinoDoc RhinoDocument
        GH_Document GrasshopperDocument
        IGH_Component Component
        int Iteration

      Methods (Virtual & overridable):
        Print(string text)
        Print(string format, params object[] args)
        Reflect(object obj)
        Reflect(object obj, string method_name)
    */
    #endregion

    double[,] gps = new double[,]
    {
        {-1.0 / Math.Sqrt(3.0), -1.0 / Math.Sqrt(3.0), 1.0, 1.0 },
        { 1.0 / Math.Sqrt(3.0), -1.0 / Math.Sqrt(3.0), 1.0, 1.0},
        { 1.0 / Math.Sqrt(3.0), 1.0 / Math.Sqrt(3.0), 1.0, 1.0},
        { -1.0 / Math.Sqrt(3.0), 1.0 / Math.Sqrt(3.0), 1.0, 1.0}//(xi,eta,wi,wj)
    };
    
    private void RunScript(
	Mesh Mesh,
	double E,
	double Nu,
	double Section,
	List<object> Boundaries,
	List<object> Loads,
	ref object Disp,
	ref object Stress)
    {
        Matrix<double> D = calcD(E,Nu);
        var faces = Mesh.Faces;
        var vertices = Mesh.Vertices;

        //剛性マトリクスの計算
        Matrix<double> K = Matrix<double>.Build.Dense(vertices.Count * 2, vertices.Count * 2);
        for(int i = 0; i < faces.Count; i++)
        {
            MeshFace face = faces.GetFace(i);
            Matrix<double> x = Matrix<double>.Build.DenseOfArray(new double[,]
            {
                {vertices[face.A].X},{vertices[face.B].X},{vertices[face.C].X},{vertices[face.D].X}
            });
            Matrix<double> y = Matrix<double>.Build.DenseOfArray(new double[,]
            {
                {vertices[face.A].Y},{vertices[face.B].Y},{vertices[face.C].Y},{vertices[face.D].Y}
            });
            Matrix<double> Ke = calcKe(x,y,Section,D);

            for (int j = 0; j < 4; j++)
            {
                for (int k = 0; k < 4; k++)
                {
                    int nodej = GetFaceVertexIndex(face,j);
                    int nodek = GetFaceVertexIndex(face,k);
                    K[2 * nodej, 2 * nodek] += Ke[2 * j, 2 * k];
                    K[2 * nodej, 2 * nodek + 1] += Ke[2 * j, 2 * k + 1];
                    K[2 * nodej + 1, 2 * nodek] += Ke[2 * j + 1, 2 * k];
                    K[2 * nodej + 1, 2 * nodek + 1] += Ke[2 * j + 1, 2 * k + 1];
                }
            }
        }

        //荷重条件の設定
        Matrix<double> f = Matrix<double>.Build.Dense(vertices.Count * 2, 1);
        for(int i = 0 ; i < Loads.Count ; i++ )
        {
            var load = ((int ID,int VertexID,double FX,double FY)) Loads[i];
            f[load.VertexID * 2, 0] = load.FX;
            f[load.VertexID * 2 + 1, 0] = load.FY;
        }


        //境界条件の設定
        for(int i = 0; i < Boundaries.Count; i++)
        {
            var  boundary = ((int ID,int VertexID,bool DX,bool DY)) Boundaries[i];
            if(boundary.DX)
            {
                for (int j = 0; j < vertices.Count * 2; j++)
                {
                    K[boundary.VertexID * 2, j] = 0.0;
                    K[j, boundary.VertexID * 2] = 0.0;
                }
                K[boundary.VertexID * 2, boundary.VertexID * 2] = 1.0; 
                f[boundary.VertexID * 2,0] = 0.0;    
            }
            if(boundary.DY)
            {
                for (int j = 0; j < vertices.Count * 2; j++)
                {
                    K[boundary.VertexID * 2 + 1, j] = 0.0;
                    K[j, boundary.VertexID * 2 + 1] = 0.0;
                }
                K[boundary.VertexID * 2 + 1, boundary.VertexID * 2 + 1] = 1.0;    
                f[boundary.VertexID * 2 + 1,0] = 0.0;     
            }
        }
        

        //行列計算
        Matrix<double> d = K.Solve(f);
        //Matrix<double> d = K.Inverse() * f;
        List<Vector3d> dispVec = new List<Vector3d>();
        for(int i = 0; i < vertices.Count; i++)
        {
            double x = d[i * 2 ,0];
            double y = d[i * 2 + 1,0];
            double z = 0;
            dispVec.Add(new Vector3d(x,y,z));
        }
        Disp = dispVec;
        Stress = calc_stress(vertices,faces,d,D,Section);
    }

    //Dマトリクスの算定
    private Matrix<double> calcD(double E , double nu)
    {
        Matrix<double> D = Matrix<double>.Build.DenseOfArray(new double[,]
        {
            {1, nu, 0},
            {nu, 1, 0},
            {0, 0, (1-nu)/2}
        });
        D = D * E / (1 - Math.Pow(nu, 2));
        return D;
    }
    //Jマトリクスの算定
    private Matrix<double> calcJ(Matrix<double> x,Matrix<double> y,double xi,double eta)
    {
        Matrix<double> dndxi = Matrix<double>.Build.DenseOfArray(new double[,]
        {
                {(-1+eta)/4,(1-eta)/4,(1+eta)/4,(-1-eta)/4 }
        });
        Matrix<double> dndeta = Matrix<double>.Build.DenseOfArray(new double[,]
        {
                {(-1+xi)/4,(-1-xi)/4,(1+xi)/4,(1-xi)/4 }
        });

        Matrix<double> dxdxi = dndxi * x;
        Matrix<double> dydxi = dndxi * y;
        Matrix<double> dxdeta = dndeta * x;
        Matrix<double> dydeta = dndeta * y;

        Matrix<double> J = Matrix<double>.Build.DenseOfArray(new double[,]
        {
            {dxdxi[0,0],dydxi[0,0]},
            {dxdeta[0, 0],dydeta[0, 0]}
        });
        return J;
    }
    // private Matrix<double> calcB(Matrix<double> x,Matrix<double> y,double xi,double eta)
    // {
    //     Matrix<double> dndxi = Matrix<double>.Build.DenseOfArray(new double[,]
    //     {
    //             {(-1+eta)/4,(1-eta)/4,(1+eta)/4,(-1-eta)/4 }
    //     });
    //     Matrix<double> dndeta = Matrix<double>.Build.DenseOfArray(new double[,]
    //     {
    //             {(-1+xi)/4,(-1-xi)/4,(1+xi)/4,(1-xi)/4 }
    //     });
        
    //     Matrix<double> J = calcJ(x,y,xi,eta);

    //     Matrix<double> B = Matrix<double>.Build.Dense(3, 8);

    //     for (int i = 0; i < 4; i++)
    //     {
    //         Matrix<double> Bi = J.Solve(Matrix<double>.Build.DenseOfArray(new double[2, 1] { { dndxi[0, i] }, { dndeta[0, i] } }));
    //         B[0, 2 * i] = Bi[0, 0];
    //         B[1, 2 * i + 1] = Bi[1, 0];
    //         B[2, 2 * i] = Bi[1, 0];
    //         B[2, 2 * i + 1] = Bi[0, 0];
            
    //     }
    //     return B; 
    // }
    public Matrix<double> calcBc(Matrix<double> x,Matrix<double> y, double xi, double eta)
    {
        Matrix<double> dndxi = Matrix<double>.Build.DenseOfArray(new double[,]
        {
                {(-1+eta)/4,(1-eta)/4,(1+eta)/4,(-1-eta)/4 }
        });
        Matrix<double> dndeta = Matrix<double>.Build.DenseOfArray(new double[,]
        {
                {(-1+xi)/4,(-1-xi)/4,(1+xi)/4,(1-xi)/4 }
        });
        for(int i =0 ; i <4 ; i++)
        {

        }
        Matrix<double> dxdxi = dndxi * x;
        Matrix<double> dydxi = dndxi * y;
        Matrix<double> dxdeta = dndeta * x;
        Matrix<double> dydeta = dndeta * y;
        Matrix<double> J = calcJ(x,y,xi,eta);

        Matrix<double> Bc = Matrix<double>.Build.Dense(3, 8);

        for (int i = 0; i < 4; i++)
        {
            Matrix<double> Bi = J.Solve(Matrix<double>.Build.DenseOfArray(new double[2, 1] { { dndxi[0, i] }, { dndeta[0, i] } }));
            Bc[0, 2 * i] = Bi[0, 0];
            Bc[1, 2 * i + 1] = Bi[1, 0];
            Bc[2, 2 * i] = Bi[1, 0];
            Bc[2, 2 * i + 1] = Bi[0, 0];
        }
        return Bc;
    }
    //Biマトリクス(3x4)を計算するメソッド
    public Matrix<double> calcBi(Matrix<double> x,Matrix<double> y, double xi, double eta)
    {
        Matrix<double> J = calcJ(x,y,xi,eta);
        Matrix<double> invJ =J.Inverse();
        Matrix<double> Bi = Matrix<double>.Build.DenseOfArray(new double[3, 4]
        {
            {-2*xi*invJ[0,0],-2*eta*invJ[0,1],0,0},
            {0,0,-2*xi*invJ[1,0],-2*eta*invJ[1,1]},
            {-2*xi*invJ[1,0],-2*eta*invJ[1,1],-2*xi*invJ[0,0],-2*eta*invJ[0,1]}
        });
        return Bi;
    }
    public Matrix<double> calcKe(Matrix<double> x,Matrix<double> y,double Section,Matrix<double> D)
    {
        Matrix<double> Kcc = Matrix<double>.Build.Dense(8, 8);
        Matrix<double> Kci = Matrix<double>.Build.Dense(8, 4);
        Matrix<double> Kic = Matrix<double>.Build.Dense(4, 8);
        Matrix<double> Kii = Matrix<double>.Build.Dense(4, 4);

        for (int i = 0; i < gps.GetLength(0); i++)
        {
            double xi = gps[i, 0];
            double eta = gps[i, 1];
            double wi = gps[i, 2];
            double wj = gps[i, 3];
            Matrix<double> J = calcJ(x,y,xi,eta);
            Matrix<double> Bc = calcBc(x,y,xi,eta);
            Matrix<double> Bi = calcBi(x,y,xi,eta);
            Matrix<double> BcT = Bc.Transpose();
            Matrix<double> BiT = Bi.Transpose();

            Kcc += wi * wj * BcT * D * Bc * J.Determinant() * Section;
            Kci += wi * wj * BcT * D * Bi * J.Determinant() * Section;
            Kic += wi * wj * BiT * D * Bc * J.Determinant() * Section;
            Kii += wi * wj * BiT * D * Bi * J.Determinant() * Section;
        }
        var Ke = Kcc - Kci * Kii.Solve(Kic);
        return Ke;
    }
    private Matrix<double> calcBe(Matrix<double> x,Matrix<double> y,double _xi, double _eta,Matrix<double> D,double Section)
    {
        Matrix<double> Kcc = Matrix<double>.Build.Dense(8, 8);
        Matrix<double> Kci = Matrix<double>.Build.Dense(8, 4);
        Matrix<double> Kic = Matrix<double>.Build.Dense(4, 8);
        Matrix<double> Kii = Matrix<double>.Build.Dense(4, 4);

        for (int i = 0; i < gps.GetLength(0); i++)
        {
            double xi = gps[i, 0];
            double eta = gps[i, 1];
            double wi = gps[i, 2];
            double wj = gps[i, 3];
            Matrix<double> J = calcJ(x,y,xi,eta);
            Matrix<double> Bc = calcBc(x,y,xi,eta);
            Matrix<double> Bi = calcBi(x,y,xi,eta);
            Matrix<double> BcT = Bc.Transpose();
            Matrix<double> BiT = Bi.Transpose();

            Kcc += wi * wj * BcT * D * Bc * J.Determinant() * Section;
            Kci += wi * wj * BcT * D * Bi * J.Determinant() * Section;
            Kic += wi * wj * BiT * D * Bc * J.Determinant() * Section;
            Kii += wi * wj * BiT * D * Bi * J.Determinant() * Section;
        }
        var Be = calcBc(x,y, _xi, _eta) - calcBi(x,y, _xi, _eta) * Kii.Solve(Kic);
        return Be;
    }
    // private Matrix<double> calcKe(Matrix<double> x,Matrix<double> y,double section ,Matrix<double> D,double[,]gps)
    // {
    //     Matrix<double> Ke = Matrix<double>.Build.DenseOfArray(new double[8, 8]);//８ｘ８のゼロ行列
    //     for (int i = 0; i < gps.GetLength(0); i++)
    //     {
    //         double xi = gps[i, 0];
    //         double eta = gps[i, 1];
    //         double wi = gps[i, 2];
    //         double wj = gps[i, 3];
    //         Matrix<double> J = calcJ(x,y, xi, eta);
    //         Matrix<double> B = calcB(x,y, xi, eta);
    //         Matrix<double> Kei = B.Transpose() * D * B * J.Determinant() * section * wi * wj;
    //         Ke += Kei;
    //     }
    //     return Ke;
    // }
    private int GetFaceVertexIndex(MeshFace face, int i)
    {
        return i switch
        {
            0 => face.A,
            1 => face.B,
            2 => face.C,
            3 => face.IsQuad ? face.D : face.C, // 三角形のときD=C
            _ => throw new ArgumentOutOfRangeException(nameof(i))
        };
    }

    public DataTree<double> calc_stress(MeshVertexList vertices,MeshFaceList faces,Matrix<double> d,Matrix<double> D,double Section)
    {
        Matrix<double> stress = Matrix<double>.Build.Dense(vertices.Count, 4);
        DataTree<double> res = new DataTree<double>();
        List<int> node_count = Enumerable.Repeat(0, vertices.Count).ToList();

        for (int i = 0; i <faces.Count;i++)
        {
            MeshFace face = faces.GetFace(i);
            Matrix<double> x = Matrix<double>.Build.DenseOfArray(new double[,]
            {
                {vertices[face.A].X},{vertices[face.B].X},{vertices[face.C].X},{vertices[face.D].X}
            });
            Matrix<double> y = Matrix<double>.Build.DenseOfArray(new double[,]
            {
                {vertices[face.A].Y},{vertices[face.B].Y},{vertices[face.C].Y},{vertices[face.D].Y}
            });
            Matrix<double> d_elem = Matrix<double>.Build.Dense(4 * 2, 1);
            for(int j = 0; j <4;j++)
            {
                int nodej = GetFaceVertexIndex(face,j);
                d_elem[j *2 ,0] = d[nodej * 2 ,0];
                d_elem[2 * j + 1, 0] = d[2 * nodej + 1, 0]; 
            }

            
            Matrix<double> stress_gps = Matrix<double>.Build.Dense(4, 3);
            for (int j = 0; j < gps.GetLength(0); j++)
            {
                double xi = gps[j, 0];
                double eta = gps[j, 1];
                Matrix<double> B = Matrix<double>.Build.Dense(3, 8);
                B = calcBe(x,y,xi,eta,D,Section);
                Matrix<double> stress_gp = D * B * d_elem;//積分点での応力を算定3x1matrix
                for (int k = 0; k < 3; k++)
                {
                    stress_gps[j, k] += stress_gp[k, 0];
                }
            }

            //積分点応力から節点応力を計算
            Matrix<double> N = Matrix<double>.Build.DenseOfArray(new double[4, 4]{
                { 2 + Math.Sqrt(3.0),-1,2 - Math.Sqrt(3.0),-1},
                { -1,2 + Math.Sqrt(3.0),-1,2 - Math.Sqrt(3.0)},
                {2 - Math.Sqrt(3.0),-1,2 + Math.Sqrt(3.0),-1},
                { -1,2 - Math.Sqrt(3.0),-1,2 + Math.Sqrt(3.0)}
            });

            Matrix<double> stress_node = N / 2 * stress_gps; //4x3matrix要素内の節点

            for(int j = 0; j < 4 ; j++)
            {
                int nodej = GetFaceVertexIndex(face,j);
                double sigxx = stress_node[j, 0];
                double sigyy = stress_node[j, 1];
                double tauxy = stress_node[j, 2];
                double mises = Math.Sqrt(Math.Pow(sigxx, 2) - sigxx * sigyy + Math.Pow(sigyy, 2) + 3 * Math.Pow(tauxy, 2));

                node_count[nodej] += 1;
                stress[nodej, 0] += sigxx;
                stress[nodej, 1] += sigyy;
                stress[nodej, 2] += tauxy;
                stress[nodej, 3] += mises;
            }
        }
        for (int i = 0; i < vertices.Count; i++)
        {
            for(int j =0 ; j < 4; j++)
            {
                stress[i, j] /= node_count[i];
            }
        }
        for (int i = 0; i < stress.ColumnCount; i++)
        {
            GH_Path path = new GH_Path(i);
            for (int j = 0; j < vertices.Count; j++)
            {
                res.Add(stress[j, i], path);
            }
        }

        return res;
    }
}
# ---------- end solver ----------

value_list = ValueList({"sigxx": 0, "sigyy": 1, "tauxy": 2, "mises": 3}, selected="mises")
# ▽描画
c_script = CSharpScript(
    Mesh=quad_remesh,
    Disp=solver.Disp,
    Stress=solver.Stress,
    StressType=value_list,
    DeformationRatio=Slider(1, range=0..150))  # -> DeformedMesh, Colour, Tags; inputs Mesh: Mesh, Disp: list of Vector3d, Stress: tree of Double, StressType: Int32, DeformationRatio: Double
# ---------- c_script: C# ----------
// Grasshopper Script Instance
#region Usings
using System;
using System.Linq;
using System.Collections;
using System.Collections.Generic;
using System.Drawing;

using Rhino;
using Rhino.Geometry;

using Grasshopper;
using Grasshopper.Kernel;
using Grasshopper.Kernel.Data;
using Grasshopper.Kernel.Types;
#endregion

public class Script_Instance : GH_ScriptInstance
{
    #region Notes
    /* 
      Members:
        RhinoDoc RhinoDocument
        GH_Document GrasshopperDocument
        IGH_Component Component
        int Iteration

      Methods (Virtual & overridable):
        Print(string text)
        Print(string format, params object[] args)
        Reflect(object obj)
        Reflect(object obj, string method_name)
    */
    #endregion

    private void RunScript(
	Mesh Mesh,
	List<Vector3d> Disp,
	DataTree<double> Stress,
	int StressType,
	double DeformationRatio,
	ref object DeformedMesh,
	ref object Colour,
	ref object Tags)
    {
        //変形後のメッシュの描画
        Mesh deformedMesh = Mesh.DuplicateMesh();
        int vertexCount = deformedMesh.Vertices.Count;
        GH_Path path = new GH_Path(StressType);
        List<double> selectedStress = Stress.Branch(path);

        List<Color> nodesColor = GetColors(selectedStress);

        // 各頂点に変位を加える
        for (int i = 0; i < vertexCount; i++)
        {
            Point3d original = deformedMesh.Vertices[i];

            // 変位を反映
            Point3d moved = new Point3d(original) + Disp[i] * DeformationRatio;
            deformedMesh.VertexColors.SetColor(i,nodesColor[i]);
            deformedMesh.Vertices.SetVertex(i, moved);
        }

        //出力するタグの処理
        List<double> tagList = new List<double>();
        List<Color> tagColor = new List<Color>();
        int COLORLEVEL = 10;
        for (int i = 0; i < COLORLEVEL; i++)
        {
            tagList.Add(selectedStress.Min() + (selectedStress.Max() - selectedStress.Min()) / (COLORLEVEL - 1) * i );
            tagColor.Add(GetJetColor((double)i / (COLORLEVEL - 1)));
        }
        tagList.Reverse();
        tagColor.Reverse();

        Colour = tagColor;
        Tags = tagList;

        DeformedMesh = deformedMesh;
    }

    public static List<Color> GetColors(List<double> value)
    {
        List<Color> colors = new List<Color>();
        double minVal = value.Min();
        double maxVal = value.Max();
        foreach (double val in value)
        {
            double ratio = (val - minVal) / (maxVal - minVal);
            colors.Add(GetJetColor(ratio));
        }
        return colors;
    }

    public static Color GetJetColor(double value)
    {
        value = Math.Max(0.0, Math.Min(1.0, value)); // 0-1にクランプ
        double r = Math.Max(0, Math.Min(1, 1.5 - Math.Abs(4 * value - 3)));
        double g = Math.Max(0, Math.Min(1, 1.5 - Math.Abs(4 * value - 2)));
        double b = Math.Max(0, Math.Min(1, 1.5 - Math.Abs(4 * value - 1)));
        Color color = Color.FromArgb((int)(r * 255), (int)(g * 255), (int)(b * 255));
        return color;
    }

}
# ---------- end c_script ----------
rectangle = Rectangle({Plane=PlaneXY(112.0377223, 6.106105077, 0), Size=Domain2(u=-6.699553671..6.699553671, v=-24.88405649..24.88405649)})
mesh_edges_2 = MeshEdges(Mesh=c_script.DeformedMesh)  # -> NakedEdges, InteriorEdges, NonManifoldEdges
legend = Legend(Colour=c_script.Colour, Tags=c_script.Tags, Rectangle=rectangle, LegendType=1)

tree_branch = TreeBranch(Tree=solver.Stress, Path=value_list, MaintainPaths=True)
bounds = Bounds(Numbers=tree_branch)
expression = Expression(B=thickness_mm, H=number_slider_2, L=number_slider, E=e_n_mm2, P=load_n, Expression="P•L³/(3•E•(B•H³/12))")
expression_2 = Expression(B=thickness_mm, H=number_slider_2, L=number_slider, P=load_n, Expression="P•L/((B•H²/6))")
# ▽検証
c_script_2 = CSharpScript(Disp=solver.Disp)  # -> flatten(MaxDisp); inputs Disp: list of Double
# ---------- c_script_2: C# ----------
// Grasshopper Script Instance
#region Usings
using System;
using System.Linq;
using System.Collections;
using System.Collections.Generic;
using System.Drawing;

using Rhino;
using Rhino.Geometry;

using Grasshopper;
using Grasshopper.Kernel;
using Grasshopper.Kernel.Data;
using Grasshopper.Kernel.Types;
#endregion

public class Script_Instance : GH_ScriptInstance
{
    #region Notes
    /* 
      Members:
        RhinoDoc RhinoDocument
        GH_Document GrasshopperDocument
        IGH_Component Component
        int Iteration

      Methods (Virtual & overridable):
        Print(string text)
        Print(string format, params object[] args)
        Reflect(object obj)
        Reflect(object obj, string method_name)
    */
    #endregion

    private void RunScript(List<double> Disp, ref object MaxDisp)
    {
        var D = new List<double>();
        for(int i =0; i<Disp.Count/2 ; i++)
        {
            D.Add(Disp[i+1]);
        }
        // Write your logic here
        MaxDisp = D.Max();
    }
}
# ---------- end c_script_2 ----------
deconstruct_domain = DeconstructDomain(Domain=bounds)  # -> Start, End
panel = Panel(c_script_2)
panel_2 = Panel(expression)
panel_3 = Panel(expression_2)
panel_4 = Panel(deconstruct_domain.End)
concatenate = Concatenate(FragmentA="解析値δmax=", FragmentB=panel)
concatenate_2 = Concatenate(FragmentA="理論値δmax=", FragmentB=panel_2)
concatenate_3 = Concatenate(FragmentA="解析値σmax=", FragmentB=panel_4)
concatenate_4 = Concatenate(FragmentA="理論値σmax=", FragmentB=panel_3)
number_slider_3 = Slider(-10, range=-30..-10)
number_slider_4 = Slider(52, range=0..100)
number_slider_5 = Slider(-10, range=-30..-10)
division_2 = Division(A=number_slider_3, B=2)
division_3 = Division(A=number_slider_5, B=2)
number_slider_6 = Slider(2.736, range=0..10)
number_slider_7 = Slider(2.736, range=0..10)
construct_point = ConstructPoint(XCoordinate=0, YCoordinate=number_slider_3, ZCoordinate=0)
construct_point_2 = ConstructPoint(XCoordinate=0, YCoordinate=division_2, ZCoordinate=0)
construct_point_3 = ConstructPoint(XCoordinate=number_slider_4, YCoordinate=number_slider_5, ZCoordinate=0)
construct_point_4 = ConstructPoint(XCoordinate=number_slider_4, YCoordinate=division_3, ZCoordinate=0)
text_tag_3d = TextTag3D(Location=construct_point, Text=concatenate, Size=number_slider_6, Justification=7)
text_tag_3d_2 = TextTag3D(Location=construct_point_2, Text=concatenate_2, Size=number_slider_6, Justification=7)
text_tag_3d_3 = TextTag3D(Location=construct_point_3, Text=concatenate_3, Size=number_slider_7, Justification=7)
text_tag_3d_4 = TextTag3D(Location=construct_point_4, Text=concatenate_4, Size=number_slider_7, Justification=7)
