# Grasshopper definition 1.gh (Grasshopper 1.0.8)
# plug-ins: Pufferfish, FEMur

# ---- group: 1.Geometry
L = Slider(4000, range=0..10000)
N = Slider(3, range=0..10)
H = Slider(3000, range=0..10000)
unit_x = UnitX(Factor=L)
unit_z = UnitZ(Factor=H)
_0_0_0 = Point(Point(0, 0, 0))
move = Move(Geometry=_0_0_0, Motion=unit_x)  # -> Geometry, Transform
linear_array = LinearArray(Geometry=_0_0_0, Direction=unit_z, Count=N)  # -> Geometry, Transform
linear_array_2 = LinearArray(Geometry=move.Geometry, Direction=unit_z, Count=N)  # -> Geometry, Transform
list_item = ListItem(List=linear_array.Geometry, Index=0, Wrap=True)  # -> Item, Item1, Item2
list_item_2 = ListItem(List=linear_array_2.Geometry, Index=0, Wrap=True)  # -> Item, Item1, Item2

# ---- group: 1.Geometry / Left Column
左柱 = PolyLine(Vertices=linear_array.Geometry, Closed=False)

# ---- group: 1.Geometry / Right Column
polyline = PolyLine(Vertices=linear_array_2.Geometry, Closed=False)

# ---- group: 1.Geometry / 1F beam
line = Line(StartPoint=list_item.Item2, EndPoint=list_item_2.Item2)

# ---- group: 1.Geometry / 2F beam
line_2 = Line(StartPoint=list_item.Item1, EndPoint=list_item_2.Item1)

# ---- group: 1.Geometry / Brace
line_3 = Line(StartPoint=list_item.Item, EndPoint=list_item_2.Item1)

# ---- group: 1.Geometry (continued)
merge = Merge(Data1=左柱, Data2=polyline, Data3=line, Data4=line_2)

# ---- group: 2.3.4 BeamElement
material_femur = MaterialFEMur(MaterialPreset=0)
crosssection_h_femur = CrossSectionHFEMur(H_mm=200, B_mm=100, T_w_mm=5.5, T_f_mm=8, R_mm=8)
beamelement_femur = BeamElementFEMur(
    Polylines=merge,
    Material=material_femur,
    CrossSection=crosssection_h_femur,
    BetaAngle_=0,
    P1X_0=0,
    P1X_1=0,
    P1X_2=4000,
    P1X_3=4000,
    P1X_4=0,
    P1X_5=0,
    P1Y_0=0,
    P1Y_1=0,
    P1Y_2=0,
    P1Y_3=0,
    P1Y_4=0,
    P1Y_5=0,
    P1Z_0=0,
    P1Z_1=3000,
    P1Z_2=0,
    P1Z_3=3000,
    P1Z_4=6000,
    P1Z_5=3000,
    P2X_0=0,
    P2X_1=0,
    P2X_2=4000,
    P2X_3=4000,
    P2X_4=4000,
    P2X_5=4000,
    P2Y_0=0,
    P2Y_1=0,
    P2Y_2=0,
    P2Y_3=0,
    P2Y_4=0,
    P2Y_5=0,
    P2Z_0=3000,
    P2Z_1=6000,
    P2Z_2=3000,
    P2Z_3=6000,
    P2Z_4=6000,
    P2Z_5=3000)  # -> BeamElements, Points
beamelement_femur_2 = BeamElementFEMur(
    Polylines=line_3,
    Material=material_femur,
    CrossSection=crosssection_h_femur,
    BetaAngle_=0,
    P1X_0=0,
    P1Y_0=0,
    P1Z_0=0,
    P2X_0=4000,
    P2Y_0=0,
    P2Z_0=3000)  # -> BeamElements, Points
merge_2 = Merge(Data1=beamelement_femur.BeamElements, Data2=beamelement_femur_2.BeamElements)

# ---- group: 5.6.7 Support,Load,Joint
P = Slider(1000, range=0..1000)
multiplication = Multiplication(A=P, B="3")
unit_x_2 = UnitX(Factor=multiplication)
unit_x_3 = UnitX(Factor=P)
panel = Panel("""0
2""")
joint_femur = JointFEMur(ElementsElementIDs=panel, EndRX=False, EndRY=True, EndRZ=False, StartRX=False, StartRY=False, StartRZ=False)
joint_femur_2 = JointFEMur(
    ElementsElementIDs=beamelement_femur_2.BeamElements,
    EndRX=False,
    EndRY=True,
    EndRZ=False,
    StartRX=False,
    StartRY=True,
    StartRZ=False)
pointload_femur = PointLoadFEMur(PositionsNodeIDs=list_item.Item1, Force_N=unit_x_3)
pointload_femur_2 = PointLoadFEMur(PositionsNodeIDs=list_item.Item2, Force_N=unit_x_2)
support_femur = SupportFEMur(PositionsNodeIDs=[_0_0_0, move.Geometry], RX=True, RY=False, RZ=False, UX=True, UY=True, UZ=True)
merge_3 = Merge(Data1=joint_femur_2, Data2=joint_femur)  # -> flatten(Result)
merge_4 = Merge(Data1=pointload_femur, Data2=pointload_femur_2)

# ---- group: 8.AssembleModel
assemblemodel_femur = AssembleModelFEMur(
    Elements=merge_2,
    Supports=support_femur,
    Loads=merge_4,
    Joints=merge_3,
    IsDisplayTabExpanded=True,
    LocalAxisScale=0.3,
    SelectedForceUnit=1,
    SelectedLengthUnit=2,
    ShowCrossSection=False,
    ShowElementId=True,
    ShowJoint=True,
    ShowLoad=True,
    ShowLocalAxis=False,
    ShowNodeId=True,
    ShowSupport=True)

# ---- group: 9.Run Solver
run_analysis_femur = RunAnalysisFEMur(Model=assemblemodel_femur, Run=True)  # -> AnalyzedModel, Warnings

# ---- group: 10.PostProcess
beamforceview_femur = BeamForceViewFEMur(
    AnalyzedModel=run_analysis_femur.AnalyzedModel,
    Scale=1,
    IsSectionForcesTabExpanded=True,
    SelectedForceType=5,
    SelectedForceUnit=1,
    SelectedLengthUnit=2,
    ShowFilled=True,
    ShowLegend=True,
    ShowNumbers=True)

# ----
deformationview_femur = DeformationViewFEMur(
    AnalyzedModel=run_analysis_femur.AnalyzedModel,
    Scale=1,
    IsDisplayTabExpanded=True,
    SelectedDirection=6,
    ShowLegend=True,
    ShowNumbers=True)  # -> AnalyzedModel, DeformedModel
reactionforceview_femur = ReactionForceViewFEMur(
    AnalyzedModel=run_analysis_femur.AnalyzedModel,
    Scale=1,
    IsReactionsTabExpanded=True,
    SelectedForceUnit=1,
    SelectedLengthUnit=2,
    ShowFx=True,
    ShowFy=True,
    ShowFz=True,
    ShowMx=True,
    ShowMy=True,
    ShowMz=True)

# ---- group: Q2
panel_2 = Panel("""4
5""")
panel_3 = Panel("""0
2
1
3""")
beamforces_femur = BeamForcesFEMur(AnalyzedModel=beamforceview_femur, ElementsElementIDs=panel_3)  # -> AnalyzedModel, ForcesNINode, MomentsNmmINode, ForcesNMidPoint, MomentsNmmMidPoint, ForcesNJNode, MomentsNmmJNode
beamforces_femur_2 = BeamForcesFEMur(AnalyzedModel=beamforceview_femur, ElementsElementIDs=panel_2)  # -> AnalyzedModel, ForcesNINode, MomentsNmmINode, ForcesNMidPoint, MomentsNmmMidPoint, ForcesNJNode, MomentsNmmJNode
deconstruct_vector = DeconstructVector(Vector=beamforces_femur.MomentsNmmINode)  # -> XComponent, YComponent, ZComponent
deconstruct_vector_2 = DeconstructVector(Vector=beamforces_femur.MomentsNmmMidPoint)  # -> XComponent, YComponent, ZComponent
deconstruct_vector_3 = DeconstructVector(Vector=beamforces_femur.MomentsNmmJNode)  # -> XComponent, YComponent, ZComponent
deconstruct_vector_4 = DeconstructVector(Vector=beamforces_femur_2.MomentsNmmINode)  # -> XComponent, YComponent, ZComponent
deconstruct_vector_5 = DeconstructVector(Vector=beamforces_femur_2.MomentsNmmMidPoint)  # -> XComponent, YComponent, ZComponent
deconstruct_vector_6 = DeconstructVector(Vector=beamforces_femur_2.MomentsNmmJNode)  # -> XComponent, YComponent, ZComponent
merge_5 = Merge(Data1=deconstruct_vector.YComponent, Data2=deconstruct_vector_2.YComponent, Data3=deconstruct_vector_3.YComponent)
merge_6 = Merge(Data1=deconstruct_vector_4.YComponent, Data2=deconstruct_vector_5.YComponent, Data3=deconstruct_vector_6.YComponent)
bounds = Bounds(Numbers=merge_5)
bounds_2 = Bounds(Numbers=merge_6)
deconstruct_domain = DeconstructDomain(Domain=bounds)  # -> Start, End
deconstruct_domain_2 = DeconstructDomain(Domain=bounds_2)  # -> Start, End
division = Division(A=deconstruct_domain.End, B=deconstruct_domain_2.End)
equality_within_tolerance = EqualityWithinTolerance(FirstNumber=division, SecondNumber="1", Tolerance="0.01")  # -> Equality, Inequality
panel_4 = Panel(equality_within_tolerance.Equality)

# ---- group: Q1
panel_5 = Panel("""1
5""")
beamforces_femur_3 = BeamForcesFEMur(AnalyzedModel=beamforceview_femur, ElementsElementIDs=panel_5)  # -> AnalyzedModel, ForcesNINode, MomentsNmmINode, ForcesNMidPoint, MomentsNmmMidPoint, ForcesNJNode, MomentsNmmJNode
deconstruct_vector_7 = DeconstructVector(Vector=beamforces_femur_3.ForcesNMidPoint)  # -> XComponent, YComponent, ZComponent
panel_6 = Panel(deconstruct_vector_7.ZComponent)
list_item_3 = ListItem(List=panel_6, Index=0, Wrap=True)  # -> Item, Item1
division_2 = Division(A="4", B="3")
division_3 = Division(A=list_item_3.Item, B=list_item_3.Item1)
division_4 = Division(A=division_3, B=division_2)
equality_within_tolerance_2 = EqualityWithinTolerance(FirstNumber=division_4, SecondNumber="1", Tolerance="0.01")  # -> Equality, Inequality
panel_7 = Panel(equality_within_tolerance_2.Equality)

# ---- group: Q3
panel_8 = Panel("""0
2""")
beamforces_femur_4 = BeamForcesFEMur(AnalyzedModel=beamforceview_femur, ElementsElementIDs=panel_8)  # -> AnalyzedModel, ForcesNINode, MomentsNmmINode, ForcesNMidPoint, MomentsNmmMidPoint, ForcesNJNode, MomentsNmmJNode
deconstruct_vector_8 = DeconstructVector(Vector=beamforces_femur_4.ForcesNMidPoint)  # -> XComponent, YComponent, ZComponent
panel_9 = Panel(deconstruct_vector_8.XComponent)
list_item_4 = ListItem(List=panel_9, Index=0, Wrap=True)  # -> Item, Item1
division_5 = Division(A=list_item_4.Item, B=list_item_4.Item1)
absolute = Absolute(Value=division_5)
division_6 = Division(A="3", B="10")
division_7 = Division(A=absolute, B=division_6)
equality_within_tolerance_3 = EqualityWithinTolerance(FirstNumber=division_7, SecondNumber="1", Tolerance="0.01")  # -> Equality, Inequality
panel_10 = Panel(equality_within_tolerance_3.Equality)

# ---- group: Q4
beamforces_femur_5 = BeamForcesFEMur(AnalyzedModel=beamforceview_femur, ElementsElementIDs="6")  # -> AnalyzedModel, ForcesNINode, MomentsNmmINode, ForcesNMidPoint, MomentsNmmMidPoint, ForcesNJNode, MomentsNmmJNode
panel_11 = Panel(beamforces_femur_5.ForcesNMidPoint)
multiplication_2 = Multiplication(A="5", B=P)
division_8 = Division(A=panel_11, B=multiplication_2)
equality_within_tolerance_4 = EqualityWithinTolerance(FirstNumber=division_8, SecondNumber="1", Tolerance="0.01")  # -> Equality, Inequality
panel_12 = Panel(equality_within_tolerance_4.Equality)

# ----
merge_7 = Merge(Data1=panel_7, Data2=panel_4, Data3=panel_10, Data4=panel_12)
panel_13 = Panel(merge_7)
